# Grasshopper definition inner_hops_definition.gh (Grasshopper 1.0.7)

n1 = GetNumber("4", AtLeast=1, AtMost=1, Maximum=1.797693135e+308, Minimum=-1.797693135e+308, TreeAccess=False)
n2 = GetNumber("4", AtLeast=1, AtMost=1, Maximum=1.797693135e+308, Minimum=-1.797693135e+308, TreeAccess=False)
addition = Addition(A=n1, B=n2)

# ---- group: RH_OUT:Addition_Result
num = Number(addition)

# ----
panel = Panel(num)
