# Grasshopper definition outer_hops_definition.gh (Grasshopper 1.0.7)
# plug-ins: Hops

n1 = GetNumber("2", AtLeast=1, AtMost=1, Maximum=1.797693135e+308, Minimum=-1.797693135e+308, TreeAccess=False)
n2 = GetNumber("2", AtLeast=1, AtMost=1, Maximum=1.797693135e+308, Minimum=-1.797693135e+308, TreeAccess=False)
hops = Hops(
    N1=n1,
    N2=n2,
    CacheResultsInMemory=True,
    CacheSolveResults=True,
    RemoteDefinitionLocation="C:\_Workspace\Repo\definition-library\src\GrasshopperTests\TestData\HopsTestH1.gh",
    RemoteSolveVersion=(0, 1, 0),
    ShowInput_Enabled=False,
    ShowInput_Path=False,
    SynchronousSolve=True)

# ---- group: RH_OUT:Addition_Result
num = Number(hops)

# ----
panel = Panel(num)
